# Grasshopper definition UDP_receiver.gh (Grasshopper 1.0.8)
# plug-ins: gHowl

# ---- group: 获取EEG数据
network_source = NetworkSource()  # -> NetworkAdapterIsUp, AdapterProperties, LocalIpAddress
panel = Panel(network_source.LocalIpAddress)
udp_receiver = UDPReceiver(Address=network_source.LocalIpAddress, Port="5000", Pattern=0)  # -> Info, Data

# ----
panel_2 = Panel("Power values: [6.064, 5.926, 2.208, 3.029, 25.718, 19.92, 12.072, 7.269, 5.678, 19.422, 3.188, 1.896, 2.007, 2.579, 11.338, 1.672, 0.677, 0.858, 0.457, 8.207, 0.728, 0.861, 0.366, 0.516, 1.685, 0.593, 0.208, 0.169, 0.327, 2.932, 1.457, 0.565, 0.376, 0.956, 12.405, 0.256, 0.75, 0.332, 0.399, 4.591, 1.422, 1.857, 0.685, 0.494, 7.816, 2.099, 3.458, 0.764, 0.584, 4.542, 1.816, 0.543, 0.472, 0.7, 1.415, 4.417, 1.528, 1.729, 2.63, 5.801, 18.888, 11.117, 8.35, 8.251, 8.956, 2.689, 2.956, 2.104, 1.836, 3.742],Performance metric: [False, None, False, None, False, None, None, False, None, False, None, False, None]")
panel_3 = Panel(udp_receiver.Data)
cluster = Cluster_4(text=panel_2)  # -> list, list_2

# ---- group: performance data
# freq: 每10秒采样一次
met = Panel(cluster.list_2)

# ---- group: power band data
pow = Panel(cluster.list)

# ---- group: processing power data sample
partition_list = PartitionList(List=pow, Size="5")  # -> simplify(Chunks)
flip_matrix = FlipMatrix(Data=partition_list)
panel_4 = Panel(flip_matrix)
panel_5 = Panel(partition_list)
number = Number(panel_4)
average = Average(Input=number)
theta_alpha_betal_betah_gamma = Panel(average)
alpha = Panel("1")
list_item = ListItem(List=flatten(theta_alpha_betal_betah_gamma), Index=alpha, Wrap=True)
alpha_mean = Panel(list_item)

# ---- group: processing met data sample
relaxation = Panel("6")
relaxation_2 = Panel("8")
list_item_2 = ListItem(List=met, Index=relaxation_2, Wrap=True)
list_item_3 = ListItem(List=met, Index=relaxation, Wrap=True)
panel_6 = Panel(list_item_3)
panel_7 = Panel(list_item_2)

# ----
panel_8 = Panel("""{0}
{13}""")
tree_item = TreeItem(Tree=panel_5, Path=panel_8, Index="1", Wrap=True)
number_2 = Number(tree_item)
average_2 = Average(Input=number_2)
# 这个顺序有点问题
# output sample: "eng.isActive","eng",
#     "exc.isActive","exc","lex",
#     "str.isActive","str",
#     "rel.isActive","rel",
#     "int.isActive","int",
#     "foc.isActive","foc"
alpha_mean_af3_af4 = Panel(average_2)
output_order = Panel("""    "AF3/theta","AF3/alpha","AF3/betaL","AF3/betaH","AF3/gamma",
    "F7/theta","F7/alpha","F7/betaL","F7/betaH","F7/gamma",
    "F3/theta","F3/alpha","F3/betaL","F3/betaH","F3/gamma",
    "FC5/theta","FC5/alpha","FC5/betaL","FC5/betaH","FC5/gamma",
    "T7/theta","T7/alpha","T7/betaL","T7/betaH","T7/gamma",
    "P7/theta","P7/alpha","P7/betaL","P7/betaH","P7/gamma",
    "O1/theta","O1/alpha","O1/betaL","O1/betaH","O1/gamma",
    "O2/theta","O2/alpha","O2/betaL","O2/betaH","O2/gamma",
    "P8/theta","P8/alpha","P8/betaL","P8/betaH","P8/gamma",
    "T8/theta","T8/alpha","T8/betaL","T8/betaH","T8/gamma",
    "FC6/theta","FC6/alpha","FC6/betaL","FC6/betaH","FC6/gamma",
    "F4/theta","F4/alpha","F4/betaL","F4/betaH","F4/gamma",
    "F8/theta","F8/alpha","F8/betaL","F8/betaH","F8/gamma",
    "AF4/theta","AF4/alpha","AF4/betaL","AF4/betaH","AF4/gamma"
""")

# ==== cluster Cluster_4
text = ClusterInput()
panel = Panel("""[
]""")
text_split = TextSplit(Text=text, Separators=panel)
cluster = Cluster_2(list=text_split)
list = ClusterOutput(cluster)
cluster_2 = Cluster_3(list=text_split)
list_2 = ClusterOutput(cluster_2)

# ==== cluster Cluster_2
power_data = Panel("1")
list = ClusterInput()
list_item = ListItem(List=list, Index=power_data, Wrap=True)
text_split = TextSplit(Text=list_item, Separators=", ")
cluster = Cluster(list=text_split, text=text_split)  # -> flatten(list_2)
list_2 = ClusterOutput(cluster)

# ==== cluster Cluster_3
performance_metric = Panel("3")
list = ClusterInput()
list_item = ListItem(List=list, Index=performance_metric, Wrap=True)
text_split = TextSplit(Text=list_item, Separators=" , ")
去除empty = Cluster(list=text_split, text=text_split)  # -> flatten(list_2)
list_2 = ClusterOutput(去除empty)

# ==== cluster Cluster
text = ClusterInput()
list = ClusterInput()
text_length = TextLength(Text=text)
larger_than = LargerThan(FirstNumber=text_length, SecondNumber=0)  # -> LargerThan, OrEqualTo
cull_pattern = CullPattern(List=list, CullPattern=larger_than.LargerThan)
list_2 = ClusterOutput(cull_pattern)
