# Grasshopper definition UDP_receiver_sample.gh (Grasshopper 1.0.8)
# plug-ins: BodyAnalytics, gHowl

# ---- group: 获取EEG数据
network_source = NetworkSource()  # -> NetworkAdapterIsUp, AdapterProperties, LocalIpAddress
# Power values: [6.064, 5.926, 2.208, 3.029, 25.718, 19.92, 12.072, 7.269, 5.678, 19.422, 3.188, 1.896, 2.007, 2.579, 11.338, 1.672, 0.677, 0.858, 0.457, 8.207, 0.728, 0.861, 0.366, 0.516, 1.685, 0.593, 0.208, 0.169, 0.327, 2.932, 1.457, 0.565, 0.376, 0.956, 12.405, 0.256, 0.75, 0.332, 0.399, 4.591, 1.422, 1.857, 0.685, 0.494, 7.816, 2.099, 3.458, 0.764, 0.584, 4.542, 1.816, 0.543, 0.472, 0.7, 1.415, 4.417, 1.528, 1.729, 2.63, 5.801, 18.888, 11.117, 8.35, 8.251, 8.956, 2.689, 2.956, 2.104, 1.836, 3.742],Performance metric: [False, None, False, None, False, None, None, False, None, False, None, False, None]
panel = Panel(network_source.LocalIpAddress)
udp_receiver = UDPReceiver(Address=network_source.LocalIpAddress, Port="5000", Pattern=0)  # -> Info, Data

# ----
# 这颗电池负责按一定刷新率激活
# 每次激活将最新数据传递给后面的gh电池。
number_slider = Slider(250, range=100..5000)
receive = Receive(Interval=number_slider)  # -> Timestamp, Body, PyMessage, RCSLocation

# ----
# 这颗电池负责连接服务器
boolean_toggle = BooleanToggle(True)
serverconnector = ServerConnector(Host="127.0.0.1", Port="8899", Run=boolean_toggle)

panel_2 = Panel(udp_receiver.Data)

# ----
# 将Body对象解构
# 输出一个自定义类型（body）
# 自带一个显示
plane = Plane(receive.RCSLocation)
panel_3 = Panel(receive.Timestamp)
body = Body(receive.Body)
panel_4 = Panel(receive.PyMessage)
panel_5 = Panel(receive.Body)
list_item = ListItem(List=body, Index=0, Wrap=True)
deconstruct_body = DeconstructBody(Body=list_item)  # -> Id, UniqueObjectId, ActionState, Position, Velocity, PositionCovariance, Confidence, HeadPosition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
center_box = CenterBox(Base=plane, X="0.05", Y="0.05", Z="0.05")
point = Point(deconstruct_body.BoundingBox)
panel_6 = Panel(deconstruct_body.Keypoints)
list_item_2 = ListItem(List=point, Index=6, Wrap=True)
list_item_3 = ListItem(List=point, Index=4, Wrap=True)
box_2pt = Box2Pt(PointA=list_item_3, PointB=list_item_2, Plane=PlaneXY(0, 0, 0))
mesh_colours = MeshColours(Mesh=box_2pt, Colours=ColourSwatch(SwatchColor=RGB(252, 134, 134)))
mesh_colours_2 = MeshColours(Mesh=center_box, Colours=ColourSwatch(SwatchColor=RGB(72, 255, 0)))
mesh_join = MeshJoin(Meshes=flatten([mesh_colours_2, mesh_colours]))

cluster = Cluster_4(text=udp_receiver.Data)  # -> list, list_2

# ---- group: performance data
# freq: 每10秒采样一次
met = Panel(cluster.list_2)

# ---- group: power band data
pow = Panel(cluster.list)

# ---- group: processing power data sample
partition_list = PartitionList(List=pow, Size="5")  # -> simplify(Chunks)
flip_matrix = FlipMatrix(Data=partition_list)
panel_7 = Panel(flip_matrix)
panel_8 = Panel(partition_list)
number = Number(panel_7)
average = Average(Input=number)
theta_alpha_betal_betah_gamma = Panel(average)
alpha = Panel("1")
list_item_4 = ListItem(List=flatten(theta_alpha_betal_betah_gamma), Index=alpha, Wrap=True)
alpha_mean = Panel(list_item_4)

# ---- group: processing met data sample
relaxation = Panel("6")
relaxation_2 = Panel("8")
list_item_5 = ListItem(List=met, Index=relaxation_2, Wrap=True)
list_item_6 = ListItem(List=met, Index=relaxation, Wrap=True)
panel_9 = Panel(list_item_6)
panel_10 = Panel(list_item_5)

# ----
# 负责输出数据给Server
send = Send(Timestamp=receive.Timestamp, Message="我是GH", Meshes=mesh_join)

panel_11 = Panel("""{0}
{13}""")
tree_item = TreeItem(Tree=panel_8, Path=panel_11, Index="1", Wrap=True)
number_2 = Number(tree_item)
average_2 = Average(Input=number_2)
# 这个顺序有点问题
# output sample: "eng.isActive","eng",
#     "exc.isActive","exc","lex",
#     "str.isActive","str",
#     "rel.isActive","rel",
#     "int.isActive","int",
#     "foc.isActive","foc"
alpha_mean_af3_af4 = Panel(average_2)
output_order = Panel("""    "AF3/theta","AF3/alpha","AF3/betaL","AF3/betaH","AF3/gamma",
    "F7/theta","F7/alpha","F7/betaL","F7/betaH","F7/gamma",
    "F3/theta","F3/alpha","F3/betaL","F3/betaH","F3/gamma",
    "FC5/theta","FC5/alpha","FC5/betaL","FC5/betaH","FC5/gamma",
    "T7/theta","T7/alpha","T7/betaL","T7/betaH","T7/gamma",
    "P7/theta","P7/alpha","P7/betaL","P7/betaH","P7/gamma",
    "O1/theta","O1/alpha","O1/betaL","O1/betaH","O1/gamma",
    "O2/theta","O2/alpha","O2/betaL","O2/betaH","O2/gamma",
    "P8/theta","P8/alpha","P8/betaL","P8/betaH","P8/gamma",
    "T8/theta","T8/alpha","T8/betaL","T8/betaH","T8/gamma",
    "FC6/theta","FC6/alpha","FC6/betaL","FC6/betaH","FC6/gamma",
    "F4/theta","F4/alpha","F4/betaL","F4/betaH","F4/gamma",
    "F8/theta","F8/alpha","F8/betaL","F8/betaH","F8/gamma",
    "AF4/theta","AF4/alpha","AF4/betaL","AF4/betaH","AF4/gamma"
""")

# ==== cluster Cluster_4
text = ClusterInput()
panel = Panel("""[
]""")
text_split = TextSplit(Text=text, Separators=panel)
cluster = Cluster_2(list=text_split)
cluster_2 = Cluster_3(list=text_split)
list = ClusterOutput(cluster)
list_2 = ClusterOutput(cluster_2)

# ==== cluster Cluster_2
power_data = Panel("1")
list = ClusterInput()
list_item = ListItem(List=list, Index=power_data, Wrap=True)
text_split = TextSplit(Text=list_item, Separators=", ")
cluster = Cluster(list=text_split, text=text_split)  # -> flatten(list_2)
list_2 = ClusterOutput(cluster)

# ==== cluster Cluster_3
performance_metric = Panel("3")
list = ClusterInput()
list_item = ListItem(List=list, Index=performance_metric, Wrap=True)
text_split = TextSplit(Text=list_item, Separators=" , ")
去除empty = Cluster(list=text_split, text=text_split)  # -> flatten(list_2)
list_2 = ClusterOutput(去除empty)

# ==== cluster Cluster
text = ClusterInput()
list = ClusterInput()
text_length = TextLength(Text=text)
larger_than = LargerThan(FirstNumber=text_length, SecondNumber=0)  # -> LargerThan, OrEqualTo
cull_pattern = CullPattern(List=list, CullPattern=larger_than.LargerThan)
list_2 = ClusterOutput(cull_pattern)
